# Dynamo graph Семейства_ДобавитьОбщиеПараметры_Основные.dyn (Dynamo 2.0.3.8810)

# group: Входные параметры
directory_path = Directory("C:\Users\Roman.LIDER\Desktop\Test")  # graph input
code_block = CodeBlock { "*.rfa"; }
искать_в_подпапках = BoolSelector(false)  # graph input

contents = Orchid.Core.Directory.Contents(directory=directory_path, searchString=code_block, deepSearch=искать_в_подпапках)
backgroundOpen = Orchid.RevitProject.Common.Document.BackgroundOpen(file=contents)
watch = Watch(backgroundOpen)

# group: Добавление параметров
string = StringInput("ADSK_Примечание")
list_create = List.Create(item0=string, lacing=Shortest)
groupName = StringInput("01 Обязательные ОБЩИЕ")
type = StringInput("Text")
group = StringInput("PG_DATA")
instance = BoolSelector(true, lacing=Shortest)
repotring = BoolSelector(false, lacing=Shortest)
addSharedParameter = Orchid.RevitFamily.Parameter.AddSharedParameter(familyDocument=watch, parameterName=list_create, groupName=groupName, type=type, group=group, instance=instance, reporting=repotring)
string_2 = StringInput("ADSK_URL страницы изделия")
string_3 = StringInput("ADSK_URL документации изделия")
string_4 = StringInput("ADSK_Завод-изготовитель")
string_5 = StringInput("ADSK_Наименование")
string_6 = StringInput("ADSK_Наименование краткое")
string_7 = StringInput("ADSK_Марка")
string_8 = StringInput("ADSK_Код изделия")
string_9 = StringInput("ADSK_Единица измерения")
string_10 = StringInput("ADSK_Обозначение")
string_11 = StringInput("ADSK_Предел огнестойкости")
string_12 = StringInput("ADSK_Масса элемента")
list_create_2 = List.Create(item0=string_2, item1=string_3, item2=string_4, item3=string_5, item4=string_6, item5=string_7, item6=string_8, item7=string_9, item8=string_10, item9=string_11, item10=string_12, lacing=Shortest)
groupName_2 = StringInput("01 Обязательные ОБЩИЕ")
type_2 = StringInput("Text")
group_2 = StringInput("PG_DATA")
instance_2 = BoolSelector(false, lacing=Shortest)
reporting = BoolSelector(false)
addSharedParameter_2 = Orchid.RevitFamily.Parameter.AddSharedParameter(familyDocument=watch, parameterName=list_create_2, groupName=groupName_2, type=type_2, group=group_2, instance=instance_2, reporting=reporting)
string_13 = StringInput("ADSK_Количество")
list_create_3 = List.Create(item0=string_13, lacing=Shortest)
groupName_3 = StringInput("01 Обязательные ОБЩИЕ")
type_3 = StringInput("Text")
group_3 = StringInput("INVALID")
instance_3 = BoolSelector(false, lacing=Shortest)
reporting_2 = BoolSelector(false)
addSharedParameter_3 = Orchid.RevitFamily.Parameter.AddSharedParameter(familyDocument=watch, parameterName=list_create_3, groupName=groupName_3, type=type_3, group=group_3, instance=instance_3, reporting=reporting_2)
string_14 = StringInput("ADSK_Группирование")
list_create_4 = List.Create(item0=string_14, lacing=Shortest)
groupName_4 = StringInput("05 Необязательные ОБЩИЕ")
type_4 = StringInput("Text")
group_4 = StringInput("INVALID")
instance_4 = BoolSelector(true, lacing=Shortest)
reporting_3 = BoolSelector(false)
addSharedParameter_4 = Orchid.RevitFamily.Parameter.AddSharedParameter(familyDocument=watch, parameterName=list_create_4, groupName=groupName_4, type=type_4, group=group_4, instance=instance_4, reporting=reporting_3)
string_15 = StringInput("ADSK_Материал")
list_create_5 = List.Create(item0=string_15, lacing=Shortest)
groupName_5 = StringInput("05 Необязательные ОБЩИЕ")
type_5 = StringInput("Text")
group_5 = StringInput("PG_MATERIALS")
instance_5 = BoolSelector(false, lacing=Shortest)
reporting_4 = BoolSelector(false)
addSharedParameter_5 = Orchid.RevitFamily.Parameter.AddSharedParameter(familyDocument=watch, parameterName=list_create_5, groupName=groupName_5, type=type_5, group=group_5, instance=instance_5, reporting=reporting_4)
string_16 = StringInput("ADSK_Зона")
string_17 = StringInput("ADSK_Позиция")
string_18 = StringInput("ADSK_Этаж")
list_create_6 = List.Create(lacing=Shortest)  # unwired: item0, item1
groupName_6 = StringInput("01 Обязательные ОБЩИЕ")
type_6 = StringInput("Text")
group_6 = StringInput("INVALID")
instance_6 = BoolSelector(true, lacing=Shortest)
reporting_5 = BoolSelector(false)
addSharedParameter_6 = Orchid.RevitFamily.Parameter.AddSharedParameter(familyDocument=watch, parameterName=list_create_6, groupName=groupName_6, type=type_6, group=group_6, instance=instance_6, reporting=reporting_5)  # frozen

await_ = Orchid.Core.DataStream.Await(pass=watch, waitFor=addSharedParameter)
await_2 = Orchid.Core.DataStream.Await(pass=await_, waitFor=addSharedParameter_2)
await_3 = Orchid.Core.DataStream.Await(pass=await_2)  # unwired: waitFor
await_4 = Orchid.Core.DataStream.Await(pass=await_3, waitFor=addSharedParameter_3)
await_5 = Orchid.Core.DataStream.Await(pass=await_4, waitFor=addSharedParameter_4)
await_6 = Orchid.Core.DataStream.Await(pass=await_5, waitFor=addSharedParameter_5)

# group: Присвоение значений
string_19 = StringInput("ADSK_Примечание")
string_20 = StringInput("или аналог")
setValue = Orchid.RevitFamily.Parameter.SetValue(familyDocument=await_6, parameterName=string_19, value=string_20)
string_21 = StringInput("ADSK_Количество")
string_22 = StringInput("1")
set = Orchid.RevitFamily.Formula.Set(familyDocument=await_6, parameterName=string_21, value=string_22)

await_7 = Orchid.Core.DataStream.Await(pass=await_6, waitFor=setValue)
await_8 = Orchid.Core.DataStream.Await(pass=await_7, waitFor=set)
boolean = BoolSelector(true)
close = Orchid.RevitProject.Common.Document.Close(document=await_8, save=boolean)
await_9 = Orchid.Core.DataStream.Await(pass=directory_path, waitFor=close)

# group: Очистка резервных копий
code_block_2 = CodeBlock { "*.0001.rfa"; }
contents_2 = Orchid.Core.Directory.Contents(directory=await_9, searchString=code_block_2, deepSearch=искать_в_подпапках)
deleteFile = FileSystem.DeleteFile(path=contents_2)
