# Dynamo graph Семейства_ДобавитьОбщиеПараметры_Электросети.dyn (Dynamo 2.0.3.8810)

# group: Входные параметры
directory_path = Directory("C:\Users\Roman.LIDER\Desktop\Test")  # graph input
code_block = CodeBlock { "*.rfa"; }
искать_в_подпапках = BoolSelector(false)  # graph input

contents = Orchid.Core.Directory.Contents(directory=directory_path, searchString=code_block, deepSearch=искать_в_подпапках)
backgroundOpen = Orchid.RevitProject.Common.Document.BackgroundOpen(file=contents)
watch = Watch(backgroundOpen)

# group: Добавление параметров
string = StringInput("ADSK_Количество фаз")
groupName = StringInput("04 Обязательные ИНЖЕНЕРИЯ")
type = StringInput("ElectricalCurrent")
group = StringInput("PG_ELECTRICAL")
instance = BoolSelector(false, lacing=Shortest)
repotring = BoolSelector(false, lacing=Shortest)
addSharedParameter = Orchid.RevitFamily.Parameter.AddSharedParameter(familyDocument=watch, parameterName=string, groupName=groupName, type=type, group=group, instance=instance, reporting=repotring)
string_2 = StringInput("ADSK_Напряжение")
groupName_2 = StringInput("04 Обязательные ИНЖЕНЕРИЯ")
type_2 = StringInput("ElectricalPotential")
group_2 = StringInput("PG_ELECTRICAL")
instance_2 = BoolSelector(false, lacing=Shortest)
repotring_2 = BoolSelector(false, lacing=Shortest)
addSharedParameter_2 = Orchid.RevitFamily.Parameter.AddSharedParameter(familyDocument=watch, parameterName=string_2, groupName=groupName_2, type=type_2, group=group_2, instance=instance_2, reporting=repotring_2)
string_3 = StringInput("ADSK_Ток")
string_4 = StringInput("ADSK_Номинальная мощность")
groupName_3 = StringInput("04 Обязательные ИНЖЕНЕРИЯ")
type_3 = StringInput("ElectricalPower")
group_3 = StringInput("PG_ELECTRICAL_LOADS")
instance_3 = BoolSelector(false, lacing=Shortest)
repotring_3 = BoolSelector(false, lacing=Shortest)
addSharedParameter_3 = Orchid.RevitFamily.Parameter.AddSharedParameter(familyDocument=watch, parameterName=string_4, groupName=groupName_3, type=type_3, group=group_3, instance=instance_3, reporting=repotring_3)

await_ = Orchid.Core.DataStream.Await(pass=watch, waitFor=addSharedParameter)
await_2 = Orchid.Core.DataStream.Await(pass=await_, waitFor=addSharedParameter_2)
groupName_4 = StringInput("04 Обязательные ИНЖЕНЕРИЯ")
type_4 = StringInput("ElectricalCurrent")
group_4 = StringInput("PG_ELECTRICAL")
instance_4 = BoolSelector(false, lacing=Shortest)
repotring_4 = BoolSelector(false, lacing=Shortest)
addSharedParameter_4 = Orchid.RevitFamily.Parameter.AddSharedParameter(familyDocument=watch, parameterName=string_3, groupName=groupName_4, type=type_4, group=group_4, instance=instance_4, reporting=repotring_4)
await_3 = Orchid.Core.DataStream.Await(pass=await_2, waitFor=addSharedParameter_4)
await_4 = Orchid.Core.DataStream.Await(pass=await_3, waitFor=addSharedParameter_3)
boolean = BoolSelector(true)
close = Orchid.RevitProject.Common.Document.Close(document=await_4, save=boolean)
await_5 = Orchid.Core.DataStream.Await(pass=directory_path, waitFor=close)

# group: Очистка резервных копий
code_block_2 = CodeBlock { "*.0001.rfa"; }
contents_2 = Orchid.Core.Directory.Contents(directory=await_5, searchString=code_block_2, deepSearch=искать_в_подпапках)
deleteFile = FileSystem.DeleteFile(path=contents_2)
