# Dynamo graph Семейства_ДобавитьФормулы_Оборудование_КотелГазовый.dyn (Dynamo 2.0.3.8810)

# group: Входные параметры
directory_path = Directory("C:\Users\Roman.LIDER\Desktop\Test")  # graph input
code_block = CodeBlock { "*.rfa"; }
искать_в_подпапках = BoolSelector(false)  # graph input

contents = Orchid.Core.Directory.Contents(directory=directory_path, searchString=code_block, deepSearch=искать_в_подпапках)
backgroundOpen = Orchid.RevitProject.Common.Document.BackgroundOpen(file=contents)
watch = Watch(backgroundOpen)
string = StringInput("ЦИ_Расход газа")

# group: Добавление общих параметров
string_2 = StringInput("ADSK_Расход теплоносителя")
string_3 = StringInput("ADSK_Тепловая мощность")
list_create = List.Create(item0=string_2, item1=string_3, item2=string, lacing=Shortest)
groupName = StringInput("04 Обязательные ИНЖЕНЕРИЯ")
type = StringInput("Text")
group = StringInput("PG_MECHANICAL")
instance = BoolSelector(true, lacing=Shortest)
repotring = BoolSelector(false, lacing=Shortest)
addSharedParameter = Orchid.RevitFamily.Parameter.AddSharedParameter(familyDocument=watch, parameterName=list_create, groupName=groupName, type=type, group=group, instance=instance, reporting=repotring)
string_4 = StringInput("ADSK_КПД")
groupName_2 = StringInput("08 Необязательные ИНЖЕНЕРИЯ")
type_2 = StringInput("Text")
group_2 = StringInput("PG_MECHANICAL")
instance_2 = BoolSelector(true, lacing=Shortest)
reporting = BoolSelector(false)
addSharedParameter_2 = Orchid.RevitFamily.Parameter.AddSharedParameter(familyDocument=watch, parameterName=string_4, groupName=groupName_2, type=type_2, group=group_2, instance=instance_2, reporting=reporting)
string_5 = StringInput("ADSK_Группирование")
groupName_3 = StringInput("05 Необязательные ОБЩИЕ")
type_3 = StringInput("Text")
group_3 = StringInput("INVALID")
instance_3 = BoolSelector(true, lacing=Shortest)
reporting_2 = BoolSelector(false)
addSharedParameter_3 = Orchid.RevitFamily.Parameter.AddSharedParameter(familyDocument=watch, parameterName=string_5, groupName=groupName_3, type=type_3, group=group_3, instance=instance_3, reporting=reporting_2)

await_ = Orchid.Core.DataStream.Await(pass=watch, waitFor=addSharedParameter)
await_2 = Orchid.Core.DataStream.Await(pass=await_, waitFor=addSharedParameter_2)
await_3 = Orchid.Core.DataStream.Await(pass=await_2, waitFor=addSharedParameter_3)

# group: Добавление параметров проекта
string_6 = StringInput("T1")
string_7 = StringInput("T2")
list_create_2 = List.Create(item0=string_6, item1=string_7, lacing=Shortest)
type_4 = StringInput("PipingTemperature")
group_4 = StringInput("PG_MECHANICAL")
instance_4 = BoolSelector(true, lacing=Shortest)
reporting_3 = BoolSelector(false)
addParameter = Orchid.RevitFamily.Parameter.AddParameter(familyDocument=watch, parameterName=list_create_2, type=type_4, group=group_4, instance=instance_4, reporting=reporting_3)
string_8 = StringInput("ΔT")
type_5 = StringInput("PipingTemperatureDifference")
group_5 = StringInput("PG_MECHANICAL")
instance_5 = BoolSelector(true, lacing=Shortest)
reporting_4 = BoolSelector(false)
addParameter_2 = Orchid.RevitFamily.Parameter.AddParameter(familyDocument=watch, parameterName=string_8, type=type_5, group=group_5, instance=instance_5, reporting=reporting_4)

await_4 = Orchid.Core.DataStream.Await(pass=await_3, waitFor=addParameter)
await_5 = Orchid.Core.DataStream.Await(pass=await_4, waitFor=addParameter_2)

# group: Присвоение значений
string_9 = StringInput("ADSK_Группирование")
string_10 = StringInput("Оборудование")
setValue = Orchid.RevitFamily.Parameter.SetValue(familyDocument=await_5, parameterName=string_9, value=string_10)

await_6 = Orchid.Core.DataStream.Await(pass=await_5, waitFor=setValue)
string_11 = StringInput("ΔT")

# group: Установить формулы
string_12 = StringInput("ADSK_Расход теплоносителя")
string_13 = StringInput("ЦИ_Расход газа")
list_create_3 = List.Create(item0=string_11, item1=string_12, item2=string_13)
string_14 = StringInput("if(T1 > T2, T1 - T2, 0 дельта °C)")
string_15 = StringInput("if(ΔT > 0 дельта °C, ADSK_Тепловая мощность / (ΔT * 1163 1/°C * 3600 с) * (1 м³ / 1 Вт), 0 м³/ч)")
string_16 = StringInput("if(ADSK_КПД > 0, ADSK_Тепловая мощность / (1163 Вт * 8 * ADSK_КПД * 3600 с) * 1 м³, 0 м³/ч)")

list_create_4 = List.Create(item0=string_14, item1=string_15, item2=string_16)

# group (continued): Установить формулы
set = Orchid.RevitFamily.Formula.Set(familyDocument=await_6, parameterName=list_create_3, value=list_create_4)

await_7 = Orchid.Core.DataStream.Await(pass=await_6, waitFor=set)
boolean = BoolSelector(true)
close = Orchid.RevitProject.Common.Document.Close(document=await_7, save=boolean)
await_8 = Orchid.Core.DataStream.Await(pass=directory_path, waitFor=close)

# group: Очистка резервных копий
code_block_2 = CodeBlock { "*.0001.rfa"; }
contents_2 = Orchid.Core.Directory.Contents(directory=await_8, searchString=code_block_2, deepSearch=искать_в_подпапках)
deleteFile = FileSystem.DeleteFile(path=contents_2)
